# Requirement set pwmProjectReqs (R2022a)

## 1 [buttons] Нажимные кнопки (Container)

### 1.1 [buttons_1] Количество кнопок
В проекте должно быть задействовано 5 нажимных кнопок

### 1.2 [buttons_2] Расположение кнопок на панели (Informational)
Нажимные кнопки должны располагаться на панели в следующем порядке:
N
W C E
S

### 1.3 [buttons_3] Функции кнопок (Container)

#### 1.3.1 [buttons_3_1] Функция кнопки N
По нажатию кнопки N коэффициент заполнения ШИМ должен увеличиваться

#### 1.3.2 [buttons_3_2] Функция кнопки S
По нажатию кнопки S коэффициент заполнения ШИМ должен уменьшаться

#### 1.3.3 [buttons_3_3] Функция кнопки C
По нажатию кнопки С коэффициент заполнения ШИМ должен стать равным нулю

#### 1.3.4 [buttons_3_4] Функция кнопки W
По нажатию кнопки W должен происходить переход к следующему каналу ШИМ

#### 1.3.5 [buttons_3_5] Функция кнопки E
По нажатию кнопки Е должен происходить переход к предыдущему каналу ШИМ

## 2 [filter] Блок фильтрации входных сигналов (Container)
Описание работы блока
Блок обеспечивает устранение дребезга при нажатии и отпускании кнопки. Необходимо иметь возможность задания времени переходного процесса в механических контактах.

### 2.1 [filter_1] Период фильтрации
Дребезг при нажатии и отпускании кнопок длится не более 50 мс

## 3 [state_machine] Блок обработки сигналов с нажимных кнопок
Описание работы блока
Однократное непродолжительное нажатие на кнопку N (S) приводит соответственно к увеличению (уменьшению) текущего значения коэффициента заполнения на единицу. При удержании кнопки N (S) в нажатом состоянии по истечении некоторого времени происходит автоматическое увеличение или уменьшение текущего значения с установленной частотой обновления данных

### 3.1 [state_machine_1] Длительность паузы
Пауза при переходе между режимами однократного нажатия и автоматического изменения значения коэффициента заполнения должна быть 0.5 секунды

### 3.2 [state_machine_2] Период обновления данных
В режиме автоматического изменения значения коэффициента заполнения он должен увеличиваться (уменьшаться) с периодом 0.25 секунды